# Dynamo graph 190105_facade_embedding_v1.0.dyn (Dynamo 1.3.3.4111)

code_block = CodeBlock {  }
number_slider = DoubleSlider(40, range=0..100 step 0.1)
code_block_2 = CodeBlock(n=number_slider) { 0..n-1..1; 1..n..1; }
create = List.Create()  # unwired: arg0, arg1
select_edge = DSEdgeSelection()
select_edge_2 = DSEdgeSelection()
select_edge_3 = DSEdgeSelection()
select_edge_4 = DSEdgeSelection()
create_2 = List.Create(select_edge, select_edge_2, select_edge_3, select_edge_4)
byJoinedCurves = PolyCurve.ByJoinedCurves(create_2)
code_block_3 = CodeBlock { -0.15; }
offset = Curve.Offset(curve=byJoinedCurves, distance=code_block_3)
code_block_4 = CodeBlock { 1.65; 3.3; }
translate = Geometry.Translate(geometry=offset, zTranslation=code_block_4.out0)
translate_2 = Geometry.Translate(geometry=offset, zTranslation=code_block_4.out1)
create_3 = List.Create(offset, translate, translate_2)
code_block_5 = CodeBlock(nofcoor=number_slider) { 0..1..#nofcoor; }
pointAtParameter = Curve.PointAtParameter(curve=create_3, param=code_block_5, lacing=CrossProduct)
code_block_6 = CodeBlock(l=pointAtParameter) { l[0]; l[1]; l[2]; }
create_4 = List.Create(code_block_6.out1, code_block_6.out0)
transpose = List.Transpose(create_4)
code_block_7 = CodeBlock { 2; }
chop = List.Chop(list=transpose, lengths=code_block_7)
count = List.Count(chop)
code_block_8 = CodeBlock(n=count) { 0..n-1..1; }
code_block_9 = CodeBlock(n=code_block_8) { l[n][1]; }  # unwired: l
code_block_10 = CodeBlock {  }
flatten = Flatten(chop)
python_script = Python(IN[0]=flatten)
# ---------- python_script.python (21 lines) ----------
import clr
clr.AddReference('ProtoGeometry')
from Autodesk.DesignScript.Geometry import *
#The inputs to this node will be stored as a list in the IN variables.
dataEnteringNode = IN

list1 = IN[0]
final =[]
for x in range(0, len(list1), 2):
    #if len(empty) != 0:
    #    empty.clear()
    #l = [list1[x+1],list1[x+3],list1[x+2],list1[x]]
    l = [list1[x+2],list1[x],list1[x+1],list1[x+3]]
    #x = x+2
   ##   break
    final.append(l)
    if x+2 == (len(list1) -2):
      break

#Assign your output to the OUT variable.
OUT = final
# ----------------------------------------
family_types = FamilyTypes("SLIDING_PANELS_V2.0:SLIDING_PANELS_V2.0")
byPoints = AdaptiveComponent.ByPoints(points=python_script, familyType=family_types)
quadrilateral = Custom[Paneling.Quadrilateral]()  # Creates groups of points from a list of UVs or XYZs for the placement of quadrilateral panels. The placement pattern can be reversed (boolean) and shifted (integer).; unwired: seq, V
quadrilateralCheckerboard = Custom[Paneling.QuadrilateralCheckerboard]()  # Creates groups of points from a list of UVs or XYZs for the placement of quadrilateral panels in a checkerboard pattern. The placement pattern can be reversed (boolean) and shifted (integer).; unwired: seq, V, shiftPlacement
quadrilateral_2 = Custom[Paneling.Quadrilateral]()  # unwired: seq, V
create_5 = List.Create(offset, translate)
byLoft = Surface.ByLoft(create_5)
categories = Categories("Mass")
code_block_11 = CodeBlock { "mass1"; }
byGeometry = DirectShape.ByGeometry(geometry=byLoft, category=categories, name=code_block_11)
