# Dynamo graph Add Curtain Grids at Random Vals from List.dyn (Dynamo 1.3.2.2480)

# group: curtainWall
select_model_element = DSModelElementSelection()  # 1 picked in the model

# group: toggle boolean to refresh random list
boolean = BoolSelector(false)

# group: calculate grid line locations
byWallElement = RevitElements.CurtainGrid.ByWallElement(select_model_element)
code_block = CodeBlock { values = {450,850,1650,1250}; }
code_block_2 = CodeBlock { "Length"; }
getParameterValueByName = Element.GetParameterValueByName(element=select_model_element, parameterName=code_block_2)
python_script = Python(IN[0]=code_block, IN[1]=getParameterValueByName, IN[2]=boolean)
# ---------- python_script.python (26 lines) ----------
import clr
clr.AddReference('ProtoGeometry')
from Autodesk.DesignScript.Geometry import *

import sys
#The inputs to this node will be stored as a list in the IN variables.
pyt_path = r'C:\Program Files (x86)\IronPython 2.7\Lib'
sys.path.append(pyt_path)
import random

#The inputs to this node will be stored as a list in the IN variables.
vals = IN[0]
length = IN[1]
refresh = IN[2]

def addVals(nums,total):
	sum = 0
	vals = []
	i = 0
	while sum<=total:
		i = random.choice(nums)
		vals.append(i)
		sum+=i
	return vals

OUT = addVals(vals,length)
# ----------------------------------------
code_block_3 = CodeBlock(list=python_script, length=getParameterValueByName, curtWall=select_model_element)
# ---------- code_block_3.designscript (7 lines) ----------
vals = DSCore.List.RemoveItemAtIndex(list, (Count(list)-1));
amount = DSCore.List.Count(vals);
seq = 1..#amount..1;
spaces = Math.Sum(DSCore.List.TakeItems(vals,seq));
params = spaces/length;
line = curtWall.GetLocation();
points = line.PointAtParameter(params);
# ----------------------------------------

# group: Add GridLine to CurtainGrid - Freeze before deciding on grid configuration
boolean_2 = BoolSelector(false)
addGridLineByPoint = RevitElements.CurtainGrid.AddGridLineByPoint(byWallElement, code_block_3.points, boolean_2)  # frozen

# group: Visualize Gridlines
code_block_4 = CodeBlock(curtWall=select_model_element, points=code_block_3.points)
# ---------- code_block_4.designscript (8 lines) ----------
dims = curtWall<1>.GetParameterValueByName({"Unconnected Height", "Length"}<2>);
width = dims[0];
length = dims[1];
wallProfile = Autodesk.Rectangle.ByWidthLength(Autodesk.Plane.XZ(), width, length);
wallSurface = Surface.ByPatch(wallProfile);
line = curtWall.GetLocation();
spans = line.SplitByPoints(points);
lengths = Math.Round(spans.Length);
# ----------------------------------------
# note: Lengths of Panels
watch = Watch(code_block_4.lengths)
code_block_5 = CodeBlock { 0; }
# note: if direction == 0, creates U parameter line, if direction == 1, creates V parameter line
getIsoline = Surface.GetIsoline(code_block_4.wallSurface, code_block_5, code_block_3.params)
code_block_6 = CodeBlock(wallProfile=code_block_4.wallProfile, wallSurface=code_block_4.wallSurface, gridLines=getIsoline) { {wallProfile,wallSurface,gridLines}; }
watch_3d = Watch3D(code_block_6)
