# Dynamo graph shape_of_the_panels.dyn (Dynamo 1.3.3.4111)

categories = Categories("CurtainWallPanels")
all_elements_of_category = ElementsOfCategory(categories)
count = Count(all_elements_of_category)
code_block = CodeBlock(a=count) { a/12; }
code_block_2 = CodeBlock(a=code_block) { 1..a; }
code_block_3 = CodeBlock { 5; 80; }
remapRange = Math.RemapRange(numbers=code_block_2, newMin=code_block_3.out0, newMax=code_block_3.out1)
code_block_4 = CodeBlock { "ROTATION_ANGLE"; }
code_block_5 = CodeBlock { "45"; }
setParameterByName = Element.SetParameterByName(element=all_elements_of_category, parameterName=code_block_4, value=code_block_5)
code_block_6 = CodeBlock { 0..180..#25; }
code_block_7 = CodeBlock(x=code_block_6) { a = Math.Sin(x); }
code_block_8 = CodeBlock { 180..0..#26; }
code_block_9 = CodeBlock(x=code_block_8) { a = Math.Sin(x); }
create = List.Create(code_block_7, code_block_9)
flatten = Flatten(create)
remapRange_2 = Math.RemapRange(numbers=flatten, newMin=code_block_3.out0, newMax=code_block_3.out1)
reverse = List.Reverse(remapRange_2)
create_2 = List.Create(remapRange_2, reverse)
flatten_2 = Flatten(create_2)
reverse_2 = List.Reverse(reverse)
create_3 = List.Create(reverse, reverse_2)
flatten_3 = Flatten(create_3)
create_4 = List.Create(flatten_2, flatten_3, flatten_2, flatten_3, flatten_2, flatten_3)
flatten_4 = Flatten(create_4)
